# Grasshopper definition geojson_to_rhino.gh (Grasshopper 1.0.8)
# plug-ins: eleFront5

relative_path_from_gh_script_to_data_dir = Panel("./data")  # "Relative path from GH script to data directory"
file_name = Panel("20m_contours_of_5x5m_dem.geojson")
file_name_2 = Panel("epsg7415_bbox.json")
query_directory = QueryDirectory(Directory=relative_path_from_gh_script_to_data_dir, Name=file_name)  # -> graft(Directory), Directories, Files
query_directory_2 = QueryDirectory(Directory=relative_path_from_gh_script_to_data_dir, Name=file_name_2)  # -> graft(Directory), Directories, Files
file_path = FilePath(query_directory.Files)
file_path_2 = FilePath(query_directory_2.Files)
python_3_script = Python3Script(json_path=file_path)  # -> geometries, property_keys, property_values
# ---------- python_3_script: Python ----------
import json

import ghpythonlib.treehelpers as th
import Rhino.Geometry as rg


def geojson_to_rhino_geometry(geom):
    """Convert a single GeoJSON geometry to Rhino geometry."""
    geom_type = geom["type"]
    coords = geom["coordinates"]

    if geom_type == "Point":
        return rg.Point3d(coords[0], coords[1], coords[2] if len(coords) > 2 else 0)

    elif geom_type == "LineString":
        points = [rg.Point3d(c[0], c[1], c[2] if len(c) > 2 else 0) for c in coords]
        return rg.PolylineCurve(points)

    elif geom_type == "Polygon":
        # Exterior ring
        exterior = [
            rg.Point3d(c[0], c[1], c[2] if len(c) > 2 else 0) for c in coords[0]
        ]
        exterior_curve = rg.PolylineCurve(exterior, isClosed=True)

        # Create planar surface
        breps = rg.Brep.CreatePlanarBreps([exterior_curve], 0.01)
        if not breps:
            return None
        brep = breps[0]

        # Handle holes (interior rings)
        if len(coords) > 1:
            for hole in coords[1:]:
                hole_pts = [
                    rg.Point3d(c[0], c[1], c[2] if len(c) > 2 else 0) for c in hole
                ]
                hole_curve = rg.PolylineCurve(hole_pts)
                hole_brep = rg.Brep.CreatePlanarBreps([hole_curve], 0.01)
                if hole_brep:
                    diff = rg.Brep.CreateBooleanDifference([brep], hole_brep, 0.01)
                    if diff:
                        brep = diff[0]

        return brep

    else:
        return None


with open(json_path, "r") as f:
    geojson = json.load(f)

features = geojson["features"]

geometries = []
property_keys = []
property_values = []
for feat in features:
    geom = feat["geometry"]
    geometries.append([geojson_to_rhino_geometry(geom)])

    properties = feat["properties"]
    property_keys.append(list(properties.keys()))
    property_values.append(list(properties.values()))

geometries = th.list_to_tree(geometries)
property_keys = th.list_to_tree(property_keys)
property_values = th.list_to_tree(property_values)
# ---------- end python_3_script ----------
read_file = ReadFile(File=file_path_2, PerLineParse=False)
attributesfromjson = AttributesFromJSON(JSONString=read_file)
value_list = ValueList({"max_east", "max_north", "min_east", "min_north"}, selected="min_east")
value_list_2 = ValueList({"max_east", "max_north", "min_east", "min_north"}, selected="max_east")
value_list_3 = ValueList({"max_east", "max_north", "min_east", "min_north"}, selected="min_north")
value_list_4 = ValueList({"max_east", "max_north", "min_east", "min_north"}, selected="max_north")
geospatial_feature_geometries = EleFrontDataDescription(python_3_script.geometries, ShiftDepth=0, isNameSet=True)
property_values = EleFrontDataDescription(python_3_script.property_values, ShiftDepth=0, isNameSet=False)
property_keys = EleFrontDataDescription(python_3_script.property_keys, ShiftDepth=0, isNameSet=False)
curve = Curve(geospatial_feature_geometries)
elefront_attributes = EleFrontAttributes(Keys=property_keys, Values=property_values, maintainBakeName=False)  # -> Attributes, Keys, Values
get_user_value = GetUserValue(Geometry=attributesfromjson, Key=value_list)
get_user_value_2 = GetUserValue(Geometry=attributesfromjson, Key=value_list_2)
get_user_value_3 = GetUserValue(Geometry=attributesfromjson, Key=value_list_3)
get_user_value_4 = GetUserValue(Geometry=attributesfromjson, Key=value_list_4)
elevation_contours_crv = EleFrontDataDescription(curve, ShiftDepth=0, isNameSet=True)
construct_domain = ConstructDomain(DomainStart=get_user_value, DomainEnd=get_user_value_2)
construct_domain_2 = ConstructDomain(DomainStart=get_user_value_3, DomainEnd=get_user_value_4)
attributes = EleFrontDataDescription(elefront_attributes.Attributes, ShiftDepth=0, isNameSet=False)
keys = EleFrontDataDescription(elefront_attributes.Keys, ShiftDepth=0, isNameSet=False)
values = EleFrontDataDescription(elefront_attributes.Values, ShiftDepth=0, isNameSet=False)
attach_attributes = AttachAttributes(Geometry=elevation_contours_crv, Attributes=attributes)
rectangle = Rectangle(Plane=PlaneXY(0, 0, 0), XSize=construct_domain, YSize=construct_domain_2, Radius=0)  # -> Rectangle, Length
value_list_5 = ValueList({"ELEV", "fid", "ID"}, selected="ELEV")
extended_geometry = ExtendedGeometry(flatten(attach_attributes))
rectangle_2 = Rectangle(flatten(rectangle.Rectangle))
get_user_value_5 = GetUserValue(Geometry=extended_geometry, Key=value_list_5)
key_value_list = EleFrontDataDescription(value_list_5, ShiftDepth=0, isNameSet=True)
elevation_contours_attrcrv = EleFrontDataDescription(extended_geometry, ShiftDepth=0, isNameSet=True)
bbox_rec = EleFrontDataDescription(rectangle_2, ShiftDepth=0, isNameSet=True)
text = Text(flatten(get_user_value_5))
create_set = CreateSet(List=text)  # -> Set, Map
number = Number(create_set.Set)
elevation_contours_attrcrv_2 = EleFrontDataDescription(elevation_contours_attrcrv, ShiftDepth=0, isNameSet=False)
sort_list = SortList(Keys=number)  # -> Keys, ValuesValuesA
key_value_list_2 = EleFrontDataDescription(key_value_list, ShiftDepth=0, isNameSet=False)
elevations_m_nap = Panel(sort_list.Keys)
filter_by_user_attributes = FilterByUserAttributes(Key=key_value_list_2, Val=sort_list.Keys, Attributes=elevation_contours_attrcrv_2, invertFilter=False)
elevation_contours_attrcrv_3 = EleFrontDataDescription(filter_by_user_attributes, ShiftDepth=0, isNameSet=True)
closed = Closed(Curve=elevation_contours_attrcrv_3)  # -> Closed, Periodic
elevation_contours_attrcrv_4 = EleFrontDataDescription(elevation_contours_attrcrv_3, ShiftDepth=0, isNameSet=False)
boolean = Boolean(invert(closed.Closed))
cull_pattern = CullPattern(List=elevation_contours_attrcrv_4, CullPattern=boolean)
cull_pattern_2 = CullPattern(List=elevation_contours_attrcrv_4, CullPattern=closed.Closed)
open_elevation_contours_attrcrv = EleFrontDataDescription(cull_pattern, ShiftDepth=0, isNameSet=True)
elevation_contour_loops_attrcrv = EleFrontDataDescription(cull_pattern_2, ShiftDepth=0, isNameSet=True)
extended_geometry_2 = ExtendedGeometry(graft(open_elevation_contours_attrcrv))
bbox_rec_2 = EleFrontDataDescription(bbox_rec, ShiftDepth=0, isNameSet=False)
open_elevation_contours_attrcrv_2 = EleFrontDataDescription(extended_geometry_2, ShiftDepth=0, isNameSet=True)
curve_curve = CurveCurve(CurveA=extended_geometry_2, CurveB=bbox_rec_2)  # -> Points, ParamsA, ParamsB
shatter = Shatter(Curve=bbox_rec_2, Parameters=curve_curve.ParamsB)
list_item = ListItem(List=shatter, Index=0, Wrap=True)  # -> Item1, Item
suirify = Suirify(open_elevation_contours_attrcrv_2)
suirify_2 = Suirify(list_item.Item)
merge = Merge(Data1=suirify, Data2=suirify_2)
join_curves = JoinCurves(Curves=merge, Preserve=False)
curve_2 = Curve(flatten(join_curves))
