# Grasshopper definition smooth_contour_polygons.gh (Grasshopper 1.0.8)
# plug-ins: eleFront5

query_model_objects = QueryModelObjects(Layer="20m_topo_layers", Locked=True, Hidden=True, AutoUpdateState=True)
query_model_objects_2 = QueryModelObjects(Layer="manual_20m_topo_layers", Locked=True, Hidden=True, AutoUpdateState=True)
query_model_objects_3 = QueryModelObjects(Name="bbox", Locked=True, Hidden=True, AutoUpdateState=True)
model_object = ModelObject(query_model_objects)
curve = Curve(query_model_objects)
model_object_2 = ModelObject(query_model_objects_2)
rectangle = Rectangle(query_model_objects_3)
content_identity = ContentIdentity(Content=query_model_objects)  # -> Content, Id, Path
simplify_curve = SimplifyCurve(Curve=curve)  # -> Curve, Simplified; disabled
user_text = UserText(Content=model_object_2, UserTextMode=1)  # -> Content, Keys, Values
elevation_contour_polygons_mocrv = EleFrontDataDescription(model_object, ShiftDepth=0, isNameSet=True)
elevation_contour_polygons_mocrv_2 = EleFrontDataDescription(model_object_2, ShiftDepth=0, isNameSet=True)
curve_2 = Curve(graft(user_text.Content))
elefront_attributes = EleFrontAttributes(Keys=user_text.Keys, Values=user_text.Values, maintainBakeName=False)  # -> Attributes, Keys, Values
curve_3 = Curve([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])
model_object_3 = ModelObject(Object=elevation_contour_polygons_mocrv, Geometry=curve_3, Layer="simple_20m_topo_layers")  # -> Object, Geometry, Name, Layer, Visibility, Display, Drafting, Render
attach_attributes = AttachAttributes(Geometry=curve_2, Attributes=elefront_attributes.Attributes)
keys = EleFrontDataDescription(elefront_attributes.Keys, ShiftDepth=0, isNameSet=False)
values = EleFrontDataDescription(elefront_attributes.Values, ShiftDepth=0, isNameSet=False)
value_list = ValueList({"ELEV_MAX", "ELEV_MIN", "ID", "polygon_id", "polyline_type"}, selected="polygon_id")
bake_name = EleFrontDataDescription("simple_20m_topo_layers", ShiftDepth=0, isNameSet=True)
extended_geometry = ExtendedGeometry(flatten(attach_attributes))
content_cache = ContentCache(Name=bake_name, Content=model_object_3.Object, Action=2)
get_user_value = GetUserValue(Geometry=extended_geometry, Key=value_list)
text = Text(flatten(get_user_value))
create_set = CreateSet(List=text)  # -> Set, Map
value_list_2 = ValueList({"ELEV_MAX", "ELEV_MIN", "ID", "polygon_id", "polyline_type"}, selected="polyline_type")
filter_by_user_attributes = FilterByUserAttributes(Key=value_list, Val=create_set.Set, Attributes=extended_geometry, invertFilter=False)
get_user_value_2 = GetUserValue(Geometry=filter_by_user_attributes, Key=value_list_2)
